% Simulink data dictionary NFSDatabase.sldd

nfs = struct(
  unit="SI",
  inputunit="Imperial",
  weight=28184.44,
  altitude=9144,
  meanchord=1.667256,
  span=10.30224,
  refarea=16.90835328,
  crusevel=138.9888,
  q=4438.495,
  dynamicpressure=4426.81,
  pathangle=-0.32175,
  tdis=0,
  tmisalign=0,
  iH0=0,
  consumprate=0,
  gravityaccel=9.8067,
  I=[10826.21 0 0; 0 4509.451 0; 0 0 15162.11],
  Idot=repmat(0, 3, 3),
  attitude0=[0; -0.2873025; 0],
  angularvel0=[0; 0; 0],
  mass=2873.998,
  AR=6.277143,
  xcg=0.55019448,
  initialpos=[0; 0; -9144],
  aero=struct(
    e=0.85,
    k=0,
    cD1=0.03,
    cD0=0.02,
    cDu=0,
    cDalpha=0.25,
    cDM=0,
    cTx1=0.0298,
    cTxu=-0.07,
    cL1=0.378,
    cL0=0.2,
    cLu=0,
    cLalpha=5.15,
    cLalphadot=2,
    cLq=4.1,
    cLM=0,
    cm1=0,
    cm0=0.025,
    cmu=0,
    cmalpha=-0.7,
    cmalphadot=-6.95,
    cmq=-14.9,
    cmT1=0,
    cmTu=0,
    cmTalpha=0,
    cmM=0,
    cYbeta=-0.346,
    cYbetadot=0,
    cYp=-0.0827,
    cYr=0.3,
    clbeta=-0.0944,
    clbetadot=0,
    clp=-0.442,
    clr=0.0926,
    cnbeta=0.1106,
    cnbetadot=0,
    cnp=-0.0243,
    cnr=-0.139,
    cnTbeta=0,
    cDdelta_e=0,
    cDdelta_f=0,
    cDdelta_a=0,
    cDdelta_r=0,
    cLdelta_e=0.5,
    cLdelta_f=0,
    cmdelta_e=-1.12,
    cmdelta_f=0,
    cDiH=0,
    cLiH=0,
    cMiH=0,
    cYdelta_a=0,
    cYdelta_r=0.2,
    cldelta_a=0.181,
    cldelta_r=0.015,
    cndelta_a=-0.0254,
    cndelta_r=-0.0365,
    Xu=-0.01124287,
    XTu=-0.001948764,
    Xalpha=3.333617,
    Xw=0.02398479,
    Xdelta_e=-0,
    Zu=-0.1416601,
    Zalpha=-134.9073,
    Zw=-0.9706343,
    Zalphadot=-0.3124123,
    Zwdot=-0.002247752,
    Zq=-0.6404453,
    Zdelta_e=-13.02194,
    Mu=0,
    MTu=0,
    Malpha=-19.37175,
    Mw=-0.1393764,
    MTalpha=0,
    Malphadot=-1.153581,
    Mwdot=-0.008299814,
    Mq=-2.473145,
    Mdelta_e=-30.9948,
    Ybeta=-9.011183,
    Yv=-0.06483388,
    Yp=-0.07982392,
    Yr=0.2895668,
    Ydelta_a=0,
    Ydelta_r=5.208776,
    Lbeta=-6.723874,
    Lv=-0.04837709,
    Lp=-1.166787,
    Lr=0.2444446,
    Ldelta_a=12.89217,
    Ldelta_r=1.068412,
    Nbeta=5.624958,
    Nv=0.04047059,
    NTbeta=0,
    Nbetadot=0,
    Np=-0.04580283,
    Nr=-0.2619997,
    Ndelta_a=-1.291808,
    Ndelta_r=-1.856338,
    Lbetaprime=-6.723874,
    Lvprime=-0.04837709,
    Lpprime=-1.166787,
    Lrprime=0.2444446,
    Ldelta_aprime=12.89217,
    Ldelta_rprime=1.068412,
    Nbetaprime=5.624958,
    Nvprime=0.04047059,
    Npprime=-0.04580283,
    Nrprime=-0.2619997,
    Ndelta_aprime=-1.291808,
    Ndelta_rprime=-1.856338),
  Uncertainty=struct(
    Noise=struct(SampleTime=1, Power=0.1),
    Turbulence=struct(
      VonKarman=struct(Seed=[23341 23342 23343 23344], ScaleLength=762),
      Dryden=struct(Seed=[23341 23342 23343 23344], ScaleLength=533.4))),
  Coordinate=struct(Ref="NED", Lat=35.6892, Long=51.389, Alt=-1250),
  Measurement=struct(
    Rate=0.001,
    IMULoc=[0; 0; 0],
    Acc=struct(Seed=[23093; 23094; 23095], NoisePower=[1.0e-12; 1.0e-12; 1.0e-12], SFCC=[1 0 0; 0 1 0; 0 0 1]),
    Gyro=struct(Seed=[25402.3; 25403.4; 25404.5], NoisePower=[1.0e-12; 1.0e-12; 1.0e-12], SFCC=[1 0 0; 0 1 0; 0 0 1])),
  trim=struct(alpha=0.0344475, beta=0, delta_e=-0.001159358, delta_f=0, delta_a=0, delta_r=0, thrust=0.004122711),
  crusevelvec=[138.9063; 0; 4.78687],
  desired=struct(height=-9144, pitch=-0.2873025, phi=0, q=0),
  dyn=struct(
    long=struct(
      DynMat=sym(
        s="symobj::fromString(\"eJzNV01o1EAUnt2k7a5167ZUq7bFrdWDFEE9thRSWqtFigcRRCpr1szW0fw1ydqmp4oXvQpVRMGboAc9KKLgRVBED4I3L8WbF2+ehZqZZDezk0myKxYaeGTe5M173/vdWQEAkAVg7Z73FoVMh/eS9gP/Ebx1f7D2ZEAek+3asm2jRZ1sN30/gWkZIksp3ZAtJFdUWNJlDdqlmg2VEtJLtqsZlWszNU1z5xSoO6iKoAVom1lGp4jpqqEqjEwcRiJvq4bD7Hdish1FRRVibwcInwImGzrnXG1KRbINbd+3fZSNL5T8fwvYbkyxMWktKIeCfW9PGg3WGSZI/xIwAdOMobHBIoGclx0LrRCMcTYFZv2Z0iEyfAdjYxemkyumBb3AGfosgthVIA2G+ojtA6E+bF/0vks9oZomndinLFLIPm27m6Nn3tsTQOSJnKP5nQkFIzBYujBNG7rjpRvrHQn2ix7d9jEAJSFnOUxl6AXIhku8vJ2tEb2RPCuyI3P8qNsRebrKqAoSZHwsqrzqlg0rATOpmzJcqskqiSUd30wmePP2N70noZYG0vpEN0yvn6Whus4YPXvT+tj3UdZJCaXlRoWBpxEbND+c4FeJI1vv9Syn7+j6wnVU9Ifd+PicXkU6ctyUfmx1WBL/KJ1JMUyyx+aD9YFgmJZNU3UJhlZnyRhXD1L8VouvFUKGGbEV6QdNxkLSQIi/SSeN5RjDD3Gwxs3odnwk88TL12xNvwJSbHan2InEhDMziymzcDvwdHz82YeqVXrWbm6u0bOW9hvvZaog4jcbu+h89W3ExZeth7GE/uHOMtlatFNnrCXri5Bgb5ql2eCdUK9TDN/TZu3Q/ATDT26Dmmi7ZhzXhIwc/p1PuYdk/qToJnlC9iq0DHK+lftIWl5oHsvH3UUyjOwc52xcjvOcHEfqj/Irrs66qG8snjxbtwJf7iI1gzHOg+G60cN1PQEvidR5Mtt+jfSBUz82rnv3+Ya9hP7Cl/2OsqnWgj8IkZkR7EfsFN53gvtw4V3A1+1E+nu0fKHM+CIwvlD+xeZpIdUHraY6Plb63CUe9t5aH7j57O66f61oYI/Irb/Ig/nK+MMwlG1hpL9VWsH17VUOoNedH0JYfFy5jSIo5J4/wDeqJLnH5wvg+OnhR34qGvdOGsflLchN235Lv0VQ+P5kMCylxJr1fxNMYzn4o83qp/nprcR9+EwvuPX205t6HoL4RuSOTOwBRz8+/elfNePlvr4UwUj/5B2m3pry9RfXjVNk\", 2)",
        Digits=32),
      ss=ss(
        a=[-0.01319163 0.02398479 0 -9.303454; -0.1416601 -0.9706343 138.3484 3.101146; 0.001175753 -0.1313203 -3.626727 -0.4322264; 0 0 1 0],
        b=[-0; -13.02194; -30.88673; 0],
        c=[1 0 0 0; 0 1 0 0; 0 0 1 0; 0 0 0 1],
        d=[0; 0; 0; 0],
        StateName="U"; "W"; "Q"; "Theta",
        Ts=0,
        InputName="de",
        OutputName="U"; "W"; "Q"; "Theta"),
      tf=tf(
        num={[0 0 -0.3123285 183.7305 260.5732]; [0 -13.02194 -4320.526 -158.4052 -42.18674]; [0 -30.88673 -28.67712 -0.4782338 -0]; [0 0 -30.88673 -28.67712 -0.4782338]},
        den={[1 4.610553 22.18444 1.137941 0.1959758]; [1 4.610553 22.18444 1.137941 0.1959758]; [1 4.610553 22.18444 1.137941 0.1959758]; [1 4.610553 22.18444 1.137941 0.1959758]},
        Ts=0,
        InputName="de",
        OutputName="U"; "W"; "Q"; "Theta"),
      wn=[0.09449493; 4.684818],
      zeta=[0.2645265; 0.4867382],
      zero={[589.6752; -1.414834]; [-331.75158865767048+0.0i; -0.018319007029909296+0.097106908599844943i; -0.018319007029909296-0.097106908599844943i]; [0; -0.9114736; -0.0169873]; [-0.9114736; -0.0169873]},
      pole=[-2.2802798558331285+4.0924124253016059i; -2.2802798558331285-4.0924124253016059i; -0.024996411162134205+0.0911288682719344i; -0.024996411162134205-0.0911288682719344i],
      gain=[-0.3123285; -13.02194; -30.88673; -30.88673],
      cheq=sym(
        s="symobj::fromString(\"eJxjZmBgYGJgaJgGpFmYGVmBlIMUAwQwA9kiUDZQDQMnCBdXFicWF2em54GFUeSNQLg8NbMoRaEssSgzMSknVSEvMTe1WKG0ODVFITNPobgyNz8py6U0N7fSMyU1ryQzLTO1iAHZTiY0M1lAOCM/JwVNDS43gtUX5+SXoImzgXBxSUpOZhLYPi4GBOAF4eLUkuDKXMeczMTi1GKI3ySR7DiFpJ5qASYKwjjDhLRAYUNTA3IYa3xBTmkxqlnoboSoyy3NKcF0HyMIQ/UzwTz/////a0BKG6SmF+iSJROiHSBqUew4iRRerHjsB0dMfEF+OTQhIOsD+YkZic8IdQQjmntuwdzTDbRpRcy9syS6B1mOk5AbmLG74QbMDXOAYfJ7r7YvATcQtIcFuz2XYfa4AnU4+34BJStGAGHnaZg=\", 2)",
        Digits=5),
      correct=struct(
        cheq=sym(
          s="symobj::fromString(\"eJxjZmBgYGJgaJgGpFmYGVmBlIMUAwQwA9kiUDZQDQMnCBdXFicWF2em54GFUeSNQLg8NbMoRaEssSgzMSknVSEvMTe1WKG0ODVFITNPobgyNz8py6U0N7fSMyU1ryQzLTO1iAHZTiY0M1lAOCM/JwVNDS43gtUX5+SXoImzgXBxSUpOZhLYPi4GBOAF4eLUkuDKXMeczMTi1GKI3ySR7DiFpJ5qASYKwjjDhLRAYUNTA3IYa3xBTmkxqlnoboSoyy3NKcF0HyMIQ/WzIPkfHJgJQGLhlBWhE36//3vuqXSOwqK0md0x0/kYGXACRjR3nESSY8XjRrB98QX55dDEgqwP5G9mZDuYEHahu5lVH0hMTDRzVz803XHxooeiEm5Bgl8Fl05hgIQpJe5FluMk5EZm7G4Ex6t0AAPDqSuHfbLu/xCTf2V9T4GO7mLB7i5QkDJd3MLBkLmN7QiDAIo7kNWB09I8G7UrM/vjl1pznFPNen5Ft5/l626gOAemNxgYAU96egc=\", 2)",
          Digits=32),
        pole=[-2.2802798558332715-4.0924124253014362i; -2.2802798558332715+4.0924124253014362i; -0.024996411162134836+0.091128868271934518i; -0.024996411162134836-0.091128868271934518i],
        wn=[0.09449493; 4.684818],
        zeta=[0.2645265; 0.4867382])),
    lat=struct(
      DynMat=sym(
        s="symobj::fromString(\"eJzNV81P1EAUn7a7wIoCGgh+QFjEg4YL8WQw6BKQZA+EAx6MUZuuncXRftF2XcpFEhODB6/+Exz14tWL4kHjWYwnL969GA12pl06OzNtF8GEJi/tm7557/c+O1UAADIAGy/De0GRiuGtchZElxI+D8bPoQwoYfICT/M8tGKR5bb3lzE1IXL18mPNRVrNgGVLM6FXbnhQLyOr7AWmXXs43zDNoKpDy0d1BF1A25QZnQVMD2xDZ2TSMBJ5z7B9Zr0Lk+frBqoRe8dAcp3A5EF/OTBnDaR50It8O0PZ+EDJH1rAhjClxqSzoFyI18O1ykT8LDFB+peAKZjmbZMNFgnkoua7aI1gTLOpMM/blI4CwxcZG/2Ybqw5LgwDZ1sLCGJXQeVcoo/YHkv0YfuF8H2lL1HTphP7JCOdrNO2ewV6FsM1BXAXt4/mj2cUjMJg6cY0Z1t+mG6sdzxeHwhpM8IA9Iyc9WBSYRggD66K8rbUIHq5POuarwn8aNkpiHSpqA4yZCIshrYeqLabgZnUjQpXG5pBYknHV5Liu2h9N7wyamk4r08s2wn7uTLS0pmi53ReH0c+ahYpobzcGDD2lLNB86MZfpUFsq1elwV9R9cXrqOBaNhNT1etOrKQH+T0Y6fDkvhH6cyKYZY9Nh+sDwTDnOY4RkAwdDpLJoV6kB61WnqtELIdzhbXD6aGhSrDCf42nTSWKYYfEWBNm9H78ZHMkzBfCw3rPsix2Ztjh4uJYGYO5MzCo8DT8YlmH6rX6Vm7u7tBz1rab7wm1QHnNxs7fr5GNtLiy9bDZEb/CGeZ5q54uTPW1awVSLC3zVI5vmfU6yzD9+2zdmj+KsPPHIGa2HfN+IEDGTn8nc85h0i/c3STPCFvHbo22d/JeSQvLzSP5dPOIhIjWxXsTctxSZBjrv4ov9LqrJt6x+IpsXWriOVuUzMY4zyfPBOSwF5+yD3u60qB0kHm26/rveDT9NPNiN07b3ByS2+6QPPds8/JJ6utl9hexD8GRdUxGvHPRLac2TD8SI6bQ/F+Gg9Zv7ksgVV5DweHd0cuge3tJzsMXm6mTKi31H3EL6027jG8KsL0dacIZq4N/Qn/n2hMaTrvHtTepa1T4Jvz/kp0JBLa4+enYzfjn1JWP83P/U/cP17IoHnx7XdyDExwc3IfXxXA+ODM81Y449ql9euHkNsD+7NY6wHD8p1Zxh9636OD2vhZHQNFZ/RLq7Zy/hs60jm11QNOvh7rT8qHw63/BYM/Wis=\", 2)",
        Digits=32),
      ss=ss(
        a=[-0.06483388 0 -138.9888 9.303454 0
         -0.04837709 -1.166787 0.2444446 0 0
         0.04047059 -0.04580283 -0.2619997 0 0
         0 1 -0.3333327 0 0
         0 0 1.054092 0 0],
        b=[0 5.208776; 12.89217 1.068412; -1.291808 -1.856338; 0 0; 0 0],
        c=[1 0 0 0 0
         0 1 0 0 0
         0 0 1 0 0
         0 0 0 1 0
         0 0 0 0 1],
        d=repmat(0, 5, 2),
        StateName="V"; "P"; "R"; "Phi"; "Psi",
        Delay=struct(Input=[0; 0], Output=repmat(0, 5, 1), Internal=[]),
        Ts=0,
        InputName="da"; "dr",
        OutputName="V"; "P"; "R"; "Phi"; "Psi"),
      tf=tf(
        num={[0 0 179.5468 415.5134 34.99237], [0 5.208776 265.4524 325.1919 5.251303]
         [0 12.89217 3.89782 64.03051 1.424232], [0 1.068412 -0.3565642 -6.497771 -0.1444047]
         [0 -1.291808 -2.181516 -0.1360061 4.272704], [0 -1.856338 -2.124439 0.1139032 -0.433215]
         [0 0 13.32278 4.624991 64.07584], [0 0 1.68719 0.3515809 -6.535738]
         [0 0 -1.361685 -2.299519 -0.143363 4.503824], [0 0 -1.956752 -2.239355 0.1200645 -0.4566486]},
        den={[1 1.493621 6.034486 7.467227 0.1791913], [1 1.493621 6.034486 7.467227 0.1791913]
         [1 1.493621 6.034486 7.467227 0.1791913], [1 1.493621 6.034486 7.467227 0.1791913]
         [1 1.493621 6.034486 7.467227 0.1791913], [1 1.493621 6.034486 7.467227 0.1791913]
         [1 1.493621 6.034486 7.467227 0.1791913], [1 1.493621 6.034486 7.467227 0.1791913]
         [1 1.493621 6.034486 7.467227 0.1791913 0], [1 1.493621 6.034486 7.467227 0.1791913 0]},
        Delay=struct(Input=[0; 0], Output=repmat(0, 5, 1), IO=repmat(0, 5, 2)),
        Ts=0,
        InputName="da"; "dr",
        OutputName="V"; "P"; "R"; "Phi"; "Psi"),
      wn=[0; 0.02447837; 1.273299; 2.39774],
      zeta=[-1; 0.04083927; 1],
      zero={[-2.226709; -0.08752501], [-49.70695; -1.239217; -0.01636691]
       [-0.1400345193134348+2.2227845671130071i; -0.1400345193134348-2.2227845671130071i; -0.02227099130025513+0.0i], [2.648917; -2.292932; -0.02225272]
       [-1.3819017643529201+1.0802407524175561i; -1.3819017643529201-1.0802407524175561i; 1.0750724460150893+0.0i], [-1.3239166297061493+0.0i; 0.089745879577006277+0.41014472020642379i; 0.089745879577006277-0.41014472020642379i]
       [-0.17357459822831497+2.1861766395504341i; -0.17357459822831497-2.1861766395504341i], [-2.075129; 1.866747]
       [-1.3819017643529234+1.0802407524175541i; -1.3819017643529234-1.0802407524175541i; 1.0750724460150902+0.0i], [-1.3239166297061522+0.0i; 0.089745879577006166+0.41014472020642334i; 0.089745879577006166-0.41014472020642334i]},
      pole=[0.0+0.0i; -0.097921941777291077+2.3957394744371059i; -0.097921941777291077-2.3957394744371059i; -1.2732987052596796+0.0i; -0.024478374721391936+0.0i],
      gain=[179.5468 5.208776; 12.89217 1.068412; -1.291808 -1.856338; 13.32278 1.68719; -1.361685 -1.956752],
      cheq=sym(
        s="symobj::fromString(\"eJxjZmBgYGJgaJgGpFmYGVmBlIMUAwQwA9kiUDZQDQMnCBdXFicWF2em54GFUeSNQLg8NbMoRaEssSgzMSknVSEvMTe1WKG0ODVFITNPobgyNz8py6U0N7fSMyU1ryQzLTO1iAHZTiY0M1lAOCM/JwVNDS43gtUX5+SXoImzgXBxSUpOZhLYPi4GBOAF4eLUkuDKXMeczMTi1GKI3ySR7DiFpJ5qASYKwjjDhLRAYUNTA3IYa3xBTmkxqlnoboSoyy3NKcF0HyMIQ/UzwTz/////y0BKG6RmN1B3pU7pe4haFDtOIoUXKx77wRETX5BfDk0IyPpAfmJG4jNCHcGI5p4bMPeUszMwJK81n0Oie5DlOAm5gZmAGziAOpSqJK7Q0g0s2N1wDeaGn0DT2WSOlRNwA0F7WKE0ACRxbDo=\", 2)",
        Digits=5),
      correct=struct(
        cheq=sym(
          s="symobj::fromString(\"eJxjZmBgYGJgaJgGpFmYGVmBlIMUAwQwA9kiUDZQDQMnCBdXFicWF2em54GFUeSNQLg8NbMoRaEssSgzMSknVSEvMTe1WKG0ODVFITNPobgyNz8py6U0N7fSMyU1ryQzLTO1iAHZTiY0M1lAOCM/JwVNDS43gtUX5+SXoImzgXBxSUpOZhLYPi4GBOAF4eLUkuDKXMeczMTi1GKI3ySR7DiFpJ5qASYKwjjDhLRAYUNTA3IYa3xBTmkxqlnoboSoyy3NKcF0HyMIQ/WzIPkfrKe//CLj2i/uO1V72h7mztz/S/Z0VTYwXBiwAEY0+0+imoXTbeBIiy/IL4cmEmR9IP8yI9vBhLCLBVUdA+s/ILH4/Y8jRoZyEwT3y0nkTTvblHzJdAHIUArdiyzHSciNzNjdCI7PWyrL6tsS81QqYoVupW7NecQgoE43d7FgdxdIDRM/kPB4O+8a46QdlgwMHcK0dgsrdreA02JIMCNDISSiGQFSjHmD\", 2)",
          Digits=32),
        pole=[0.0+0.0i; -0.0035788898124560569+0.0i; -1.2739892363807983+0.0i; -0.10802641867120109-2.3930429040667742i; -0.10802641867120109+2.3930429040667742i],
        wn=[0; 0.00357889; 1.273989; 2.39548],
        zeta=[-1; 0.04509594; 1])),
    linsys=ss(
      a=[-0.01319163 0.02398479 0 -9.303454 0 0 0 0 0
       -0.1416601 -0.9706343 138.3484 3.101146 0 0 0 0 0
       0.001175753 -0.1313203 -3.626727 -0.4322264 0 0 0 0 0
       0 0 1 0 0 0 0 0 0
       0 0 0 0 -0.06483388 0 -138.9888 9.303454 0
       0 0 0 0 -0.04837709 -1.166787 0.2444446 0 0
       0 0 0 0 0.04047059 -0.04580283 -0.2619997 0 0
       0 0 0 0 0 1 -0.3333327 0 0
       0 0 0 0 0 0 1.054092 0 0],
      b=[-0 0 0
       -13.02194 0 0
       -30.88673 0 0
       0 0 0
       0 0 5.208776
       0 12.89217 1.068412
       0 -1.291808 -1.856338
       0 0 0
       0 0 0],
      c=[1 0 0 0 0 0 0 0 0
       0 1 0 0 0 0 0 0 0
       0 0 1 0 0 0 0 0 0
       0 0 0 1 0 0 0 0 0
       0 0 0 0 1 0 0 0 0
       0 0 0 0 0 1 0 0 0
       0 0 0 0 0 0 1 0 0
       0 0 0 0 0 0 0 1 0
       0 0 0 0 0 0 0 0 1],
      d=repmat(0, 9, 3),
      StateName="U"; "W"; "Q"; "Theta"; "V"; "P"; "R"; "Phi"; "Psi",
      Delay=struct(Input=[0; 0; 0], Output=repmat(0, 9, 1), Internal=[]),
      Ts=0,
      InputName="de"; "da"; "dr",
      OutputName="U"; "W"; "Q"; "Theta"; "V"; "P"; "R"; "Phi"; "Psi")),
  ctrl=struct(
    lqr=struct(
      long=struct(K=[0.8258489 -0.698055 -2.762408 -39.99694]),
      lat=struct(K=[0.229757 24.49412 -0.1106386 21.28716 19.99622; 7.05644 -0.4040056 -25.37565 1.463486 -0.3887662]))))

TurbulenceSelector = 0
NavigationSelector = 0